# Grasshopper definition create_bullets_read_write_json.gh (Grasshopper 1.0.7)

panel = Panel("Tested with v0.1.21")
pln = Plane([Plane(origin=(-150, 0, 0), x=(0, 1, 0), y=(1, 0, 0)), Plane(origin=(-75, 0, 0), x=(0, 1, 0), y=(1, 0, 0)), Plane(origin=(0, 0, 0), x=(0, 1, 0), y=(1, 0, 0)), Plane(origin=(75, 0, 0), x=(0, 1, 0), y=(1, 0, 0)), Plane(origin=(150, 0, 0), x=(0, 1, 0), y=(1, 0, 0))])
Z = UnitZ(Factor="300")
item = ListItem(List=pln, Index=0, Wrap=True)
move = Move(Geometry=item, Motion=Z)  # -> Geometry, Transform
pl = PlaneNormal(Origin=move.Geometry, ZAxis=Vector(0, 0, 1))
pflip = FlipPlane(Plane=pl, ReverseX=False, ReverseY=False, SwapAxes=True)

# ---- group: Set path to JSON
path = FilePath("G:\Shared drives\2020_MAS\T2_P1\02_Groups\Phase2\rcf_fabrication\02_robot_control\04_fabrication_data_jsons\20200305-13.50-Prototype-7_A-74bll.json")

# ----
panel_2 = Panel(path)
bang = Button()
series = Series(Start=0, Step=1, Count=10)

# ----
# ClayBullet creation
number_slider = Slider(0.5, range=0..1)
density = Slider(2, range=0..10)
pln_2 = Plane(pln)
pln_3 = Plane(pflip)
create_claybullet_objects = GhPythonScript(
    planes=pln_2,
    trajectory_to=pln_3,
    trajectory_from=pln_3,
    radius=Slider(45, range=0..100),
    height=Slider(100, range=0..200),
    compression_ratio=number_slider,
    vkeys=series,
    density=density)  # -> out, clay_bullets, planes, meshes; inputs planes: list of Plane, trajectory_to: tree of Plane, trajectory_from: tree of Plane, radius: list, height: list, compression_ratio: list, bullet_ids: list, vkeys: list of Int32, density: list, face_count: Int32
# ---------- create_claybullet_objects: Python ----------
import Rhino.Geometry as rg
import ghpythonlib
from ghpythonlib.treehelpers import list_to_tree, tree_to_list

import compas_rcf
from compas_rcf.utils.util_funcs import list_elem_w_index_wrap
print(compas_rcf.__version__)
from compas_rcf.fabrication.clay_obj import ClayBullet, ClayBulletEncoder
from ghpythonlib.treehelpers import Tree

kwargs = {}

print(vkeys)

clay_bullets = []
for i, plane in enumerate(planes):
    
    kwargs = {}
    # Trajectories can be a list for each bullet

    if trajectory_to.DataCount > 0:
        _trajectory_to = tree_to_list(trajectory_to)
        kwargs.update({'trajectory_to': list_elem_w_index_wrap(_trajectory_to,i)})
    if trajectory_from.DataCount > 0:
        _trajectory_from = tree_to_list(trajectory_from)
        kwargs.update({'trajectory_from': list_elem_w_index_wrap(_trajectory_from, i)})
        
    # Following keyword arguments are assumed to be one per bullet
    if len(radius) > 0:
        kwargs.update({'radius': list_elem_w_index_wrap(radius, i)})
    if len(height) > 0:
        kwargs.update({'height': list_elem_w_index_wrap(height, i)})
    if len(compression_ratio) > 0:
        kwargs.update({'compression_ratio': list_elem_w_index_wrap(compression_ratio, i)})
    if len(vkeys) > 0:
        kwargs.update({'vkey': list_elem_w_index_wrap(vkeys, i)})
    if len(density) > 0:
        kwargs.update({'density': list_elem_w_index_wrap(density, i)})
    if len(bullet_ids) > 0:
        kwargs.update({'bullet_id': list_elem_w_index_wrap(bullet_ids, i)})
    
    clay_bullets.append(ClayBullet(plane, **kwargs))

planes = [bullet.location_plane for bullet in clay_bullets]
print(clay_bullets[0].__dict__)
kwargs = {}
if face_count is not None:
    kwargs.update({'face_count': face_count})
    
def generate_mesh(cls):
    return cls.generate_mesh(**kwargs)
    
# normal    
#meshes = [bullet.generate_mesh(**kwargs) for bullet in clay_bullets]

# parallel (quicker)
meshes = ghpythonlib.parallel.run(generate_mesh, clay_bullets, flatten_results=True)
# ---------- end create_claybullet_objects ----------

unload = PythonScript(bang=bang, module="compas_rcf")
# ---------- unload: Python ----------
import sys

def unload_modules(top_level_module_name):
    """Unloads all modules named starting with the specified string.

    This function eases the development workflow when editing a library that is
    used from Rhino/Grasshopper.

    Args:
        top_level_module_name (:obj:`str`): Name of the top-level module to unload.

    Returns:
        list: List of unloaded module names.
    """
    modules = filter(lambda m: m.startswith(top_level_module_name), sys.modules)

    for module in modules:
        sys.modules.pop(module)

    return modules

unload_modules(module)
# ---------- end unload ----------

# ----
# Preview planes (Z should b down)
number_slider_2 = Slider(10, range=0..100)
cluster = Cluster(plane=flatten([pln_2, pln_3]), amplitude=number_slider_2, R=Slider(1, range=0..10))  # -> geo, color
preview = CustomPreview(Geometry=cluster.geo, Material=cluster.color)

panel_3 = Panel("G:\Shared drives\2020_MAS\T2_P1\02_Groups\Phase2\rcf_fabrication\02_robot_control\04_fabrication_data_jsons\")

# ---- group: Read JSON
# Read ClayBullets from JSON
read_claybullets_from_json = GhPythonScript(path=path)  # -> out, planes, meshes
# ---------- read_claybullets_from_json: Python ----------
import Rhino.Geometry as rg
from compas_rcf.utils.json_ import load_bullets
import ghpythonlib
from ghpythonlib.treehelpers import list_to_tree

#from compas.geometry import Frame
import json

clay_bullets = load_bullets(path)

location_planes = [bullet.location_plane for bullet in clay_bullets]

location_planes = list_to_tree(location_planes)

kwargs = {}
if face_count is not None:
    kwargs.update({'face_count': face_count})
    
def generate_mesh(cls):
    return cls.generate_mesh(**kwargs)
    
# normal    
#meshes = [bullet.generate_mesh(**kwargs) for bullet in clay_bullets]

# parallel (quicker)
meshes = ghpythonlib.parallel.run(generate_mesh, clay_bullets, flatten_results=True)
# ---------- end read_claybullets_from_json ----------

# ----
mesh = Mesh(read_claybullets_from_json.meshes)

# ---- group: Clay bullet visualization
mesh_2 = Mesh(create_claybullet_objects.meshes)

# ---- group: Write ClayBullets to JSON
write_claybullets_to_json = GhPythonScript(clay_bullets=simplify(create_claybullet_objects.clay_bullets), folder=panel_3, name="anton_test", save=Button())  # -> out; inputs clay_bullets: list, save: Boolean
# ---------- write_claybullets_to_json: Python ----------
import json
from time import strftime, gmtime
import os

from compas_rcf.fabrication.clay_obj import ClayBulletEncoder

if save is None:
    save = False

date_stamp_format = '%Y%m%d-%H.%M'
print(clay_bullets[0])
print(clay_bullets[0].__dict__)

if save:
    
    file_name = strftime(date_stamp_format, gmtime()) + "-" + name + ".json"
    full_path = os.path.join(folder, file_name)

    with open(full_path, mode='w') as fp:

        json.dump(clay_bullets, fp, cls=ClayBulletEncoder)
# ---------- end write_claybullets_to_json ----------

# ==== cluster Cluster
plane = ClusterInput()
amplitude = ClusterInput()
R = ClusterInput()
deconstruct_plane = DeconstructPlane(Plane=graft(plane))  # -> Origin, XAxis, YAxis, ZAxis
amplitude_2 = Amplitude(Vector=deconstruct_plane.XAxis, Amplitude=amplitude)
amplitude_3 = Amplitude(Vector=deconstruct_plane.YAxis, Amplitude=amplitude)
amplitude_4 = Amplitude(Vector=deconstruct_plane.ZAxis, Amplitude=amplitude)
move = Move(Geometry=deconstruct_plane.Origin, Motion=amplitude_3)  # -> Geometry, Transform
move_2 = Move(Geometry=deconstruct_plane.Origin, Motion=amplitude_4)  # -> Geometry, Transform
move_3 = Move(Geometry=deconstruct_plane.Origin, Motion=amplitude_2)  # -> Geometry, Transform
ln = Line(StartPoint=deconstruct_plane.Origin, EndPoint=move.Geometry)
ln_2 = Line(StartPoint=deconstruct_plane.Origin, EndPoint=move_3.Geometry)
ln_3 = Line(StartPoint=deconstruct_plane.Origin, EndPoint=move_2.Geometry)
pipe = Pipe(Curve=ln, Radius=R, Caps=0)  # -> simplify(Pipe)
pipe_2 = Pipe(Curve=ln_2, Radius=R, Caps=0)  # -> simplify(Pipe)
pipe_3 = Pipe(Curve=ln_3, Radius=R, Caps=0)  # -> simplify(Pipe)
path_mapper = PathMapper(pipe_2, source="{*}", target="{0}")
path_mapper_2 = PathMapper(ColourSwatch(SwatchColor=RGB(255, 0, 0)), source="{*}", target="{0}")
path_mapper_3 = PathMapper(pipe, source="{*}", target="{1}")
path_mapper_4 = PathMapper(ColourSwatch(SwatchColor=RGB(0, 255, 0)), source="{*}", target="{1}")
path_mapper_5 = PathMapper(ColourSwatch(SwatchColor=RGB(0, 0, 255)), source="{*}", target="{2}")
path_mapper_6 = PathMapper(pipe_3, source="{*}", target="{2}")
data = Data([path_mapper_6, path_mapper_3, path_mapper])
data_2 = Data([path_mapper_5, path_mapper_4, path_mapper_2])
geo = ClusterOutput(data)
color = ClusterOutput(data_2)
