# Grasshopper definition create_run_data.ghx (Grasshopper 1.0.7)

# ----
# Planes and ids
pln = Plane([Plane(origin=(16087.39849, 20962.78907, 294.0969842), x=(0.9973795379, -0.07234209321, -0.0008240179709), y=(-0.07234225369, -0.9973798527, -0.0001666003413)), Plane(origin=(15982.09152, 20968.24563, 294.1834945), x=(0.9996512856, -0.02639398014, -0.0008154837051), y=(-0.02639415493, -0.9996515927, -0.0002043223354)), Plane(origin=(15876.6673, 20967.17473, 294.268626), x=(0.9985813409, 0.0532416277, -0.0007966375137), y=(0.05324142902, -0.9985816332, -0.0002685702177)), Plane(origin=(15771.93377, 20955.44156, 294.3507909), x=(0.9841363723, 0.1774120284, -0.000756905284), y=(0.1774117948, -0.9841366375, -0.0003658629267)), Plane(origin=(15670.22516, 20928.09846, 294.4269818), x=(0.9376467516, 0.3475889895, -0.0006808359321), y=(0.3475887129, -0.9376469716, -0.0004931771726))])
txt = Text(["1AB-00-000", "1AB-00-001", "1AB-00-002", "1AB-00-003", "1AB-00-004"])

# ----
# WCS to RCS
transform = Transform({TransformCount=1, Name="Generic", m00=0.4013639721, m01=-0.9158723338, m02=0.009210324891, m03=13749.09038, m10=0.9159160155, m11=0.4013666171, m12=-0.001640526278, m13=-21419.10732, m20=-0.002194204313, m21=0.009094332218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})

# ----
# Configuration
path = FilePath("G:\Shared drives\2020_MAS\T2_P1_BuildingWorkshop\02_robot_control\01_confs\20201012-new.yaml")
panel = Panel(path)

path_2 = FilePath("C:\Users\a\Nextcloud\GK Server\01_Projekte\311_SEMusicLab\05_Production\02_robotcontrol\02_pick_frame_lists\201027-right-pick-conf.json")

path_3 = FilePath("C:\Users\a\Nextcloud\GK Server\01_Projekte\311_SEMusicLab\05_Production\02_robotcontrol\03_run_data\")
path_4 = FilePath("C:\Users\a\Nextcloud\GK Server\01_Projekte\311_SEMusicLab\05_Production\04_fab_logs\")

# ----
# Save file
save_json_file = Button()

# ---- group: Travel joint configurations
a1 = Slider(-115, range=-360..360)
a2 = Slider(-19, range=-360..360)
a3 = Slider(32, range=-360..360)
a4 = Slider(14, range=-360..360)
a5 = Slider(73, range=-360..360)
a6 = Slider(0, range=-360..360)

a1_2 = Slider(-6, range=-360..360)
a2_2 = Slider(-9, range=-360..360)
a3_2 = Slider(26, range=-360..360)
a4_2 = Slider(4, range=-360..360)
a5_2 = Slider(64, range=-360..360)
a6_2 = Slider(0, range=-360..360)

# ----
add_manual_trajectory = BooleanToggle(True)
bang = Button()

# ----
# Picking setup
panel_2 = Panel(path_2)

# ----
# Save directory
panel_3 = Panel(path_3)

# ----
# Folder for log files
panel_4 = Panel(path_4)

unload = PythonScript(bang=bang, module="rapid_clay_formations_fab")
# ---------- unload: Python ----------
import sys

def unload_modules(top_level_module_name):
    """Unloads all modules named starting with the specified string.

    This function eases the development workflow when editing a library that is
    used from Rhino/Grasshopper.

    Args:
        top_level_module_name (:obj:`str`): Name of the top-level module to unload.

    Returns:
        list: List of unloaded module names.
    """
    modules = filter(lambda m: m.startswith(top_level_module_name), sys.modules)

    for module in modules:
        sys.modules.pop(module)

    return modules

unload_modules(module)
# ---------- end unload ----------
lng = ListLength()
python = GhPythonScript(list_len=lng)  # -> out, ids
# ---------- python: Python ----------
ids = []
for p in range(list_len):
    ids.append("1DOORLEFT-00-{:03}".format(p))
# ---------- end python ----------
forward_kinematics = PythonScript(a1=a1, a2=a2, a3=a3, a4=a4, a5=a5, a6=a6)  # -> pt
# ---------- forward_kinematics: Python ----------
from compas.robots import Joint
from compas_fab.robots import JointTrajectoryPoint
from compas_fab.robots import to_radians

pt = JointTrajectoryPoint(values=to_radians([a1, a2, a3, a4, a5, a6]),types=[Joint.REVOLUTE] * 6)
print(pt)
# ---------- end forward_kinematics ----------
forward_kinematics_2 = PythonScript(a1=a1_2, a2=a2_2, a3=a3_2, a4=a4_2, a5=a5_2, a6=a6_2)  # -> pt; same code as forward_kinematics
paths = GhPythonScript(planes=flatten(pln), ids=txt)  # -> out, split_planes, split_compression_list, split_ids, file_name; inputs start: Int32, end: Int32, planes: list of Plane, compression: list, ids: list
# ---------- paths: Python ----------
import math

if not start:
    start = 0
if not end:
    end = len(planes)

if not len(compression):
    standard_value = 1 - .63
    split_compression_list = [standard_value] * (end - start)
else:
    split_compression_list = [1 - c for c in compression[start:end]]
split_planes = planes[start:end]
split_ids = ids[start:end]

level_segment = ids[0].split("-")[0]
file_name = "{}-{:03d}-{:03d}".format(level_segment, start, end)

print("{} cylinders".format(len(split_planes)))

density = 2087
r = 0.045
h = 0.15

volume_sqm = math.pi * (r ** 2) * h
weight_kg = volume_sqm * density

print("Total volume: {:.3f} sqm".format(volume_sqm * len(split_planes)))
print("Total weight: {:.3f} kg".format(weight_kg * len(split_planes)))

avg_cycle_time = 40

expected_run_duration_s = avg_cycle_time * len(split_planes)
expected_run_duration_min = expected_run_duration_s / 60
expected_run_duration_hrs = expected_run_duration_min // 60
expected_run_duration_remaining_min = expected_run_duration_min % 60

print("Expected run duration: {:.0f} hours and {:.0f} minutes.".format(
                                                               expected_run_duration_hrs,
                                                               expected_run_duration_remaining_min))
# ---------- end paths ----------
merge = Merge(Data1=forward_kinematics, Data2=forward_kinematics_2)
python_2 = GhPythonScript(trajectory_pts=merge)  # -> out, minimal_travel_trajectories; inputs trajectory_pts: list
# ---------- python_2: Python ----------
from compas_fab.robots import JointTrajectory

from rapid_clay_formations_fab.robots import MinimalTrajectory

trajectory = JointTrajectory(trajectory_pts)

minimal_travel_trajectories = [
    MinimalTrajectory.from_joint_trajectory(trajectory)
]
# ---------- end python_2 ----------
panel_5 = Panel(paths.file_name)
panel_6 = Panel(paths.out)
filter = StreamFilter(Gate=add_manual_trajectory, Stream1=python_2.minimal_travel_trajectories)
file = ReadFile(File=path, PerLineParse=False)
panel_7 = Panel(file)

# ----
# Planes
pln_2 = Plane(paths.split_planes)

# ----
# Compression
# (old format
# (0-1, larger number = less compression))
num = Number(paths.split_compression_list)

# ----
# IDs
txt_2 = Text(paths.split_ids)

# ---- group: Transformation WCS to RCS
transform_2 = Transform(transform)

# ----
transform_3 = Transform(Geometry=pln_2, Transform=transform_2)  # -> flatten(Geometry)
prot = RotatePlane(Plane=transform_3, Angle=degrees(Slider(0, range=0..100)))
egress_distance = Slider(150, range=0..1000)

# ----
# FabricationElement creation
number_slider = Slider(45, range=0..100)
number_slider_2 = Slider(150, range=0..200)
pln_3 = Plane(prot)
create_fabricationelement_objects = GhPythonScript(
    planes=pln_3,
    radius=number_slider,
    travel_trajectories=filter,
    height=number_slider_2,
    compression=num,
    id=txt_2,
    egress_frame_distance=egress_distance,
    create_meshes=Toggle(False),
    u_res=Slider(5, range=0..100))  # -> out, elements, planes, meshes, egress_planes; inputs planes: list of Plane, travel_trajectories: list, compression: list, id: list, egress_frame_distance: list of Int32, create_meshes: Boolean, u_res: Int32
# ---------- create_fabricationelement_objects: Python ----------
import Rhino.Geometry as rg
import ghpythonlib

import rapid_clay_formations_fab
from rapid_clay_formations_fab.utils import wrap_list
from rapid_clay_formations_fab.utils import ensure_frame
from rapid_clay_formations_fab.fab_data import FabricationElement
from rapid_clay_formations_fab.rhino import cgframe_to_rgplane

def generate_mesh(cls):
    return cls.get_rgmesh(u_res=u_res)

if len(planes) != len(id) and len(id) != 0:
    raise Exception("Different amount of planes and ids")

elements = []
for i, plane in enumerate(planes):

    kwargs = {}

    # Following keyword arguments are assumed to be one per element

    kwargs['radius'] = radius

    kwargs['height'] = height
    kwargs['compression_ratio'] = compression[i]

    if len(travel_trajectories) > 0:
        kwargs["travel_trajectories"] = travel_trajectories

    if len(egress_frame_distance) > 0:
        kwargs['egress_frame_distance'] = wrap_list(egress_frame_distance, i)

    elements.append(FabricationElement(ensure_frame(plane), id[i], **kwargs))

location_frames = [elem.location for elem in elements]
location_planes = [elem.get_location_rgplane() for elem in elements]

egress_frames = [elem.get_egress_frame() for elem in elements]
egress_planes = [cgframe_to_rgplane(frame) for frame in egress_frames]

if create_meshes:
    # normal
    meshes = [elem.get_rgmesh(u_res=u_res) for elem in elements]


    # parallel (quicker)
    #meshes = ghpythonlib.parallel.run(generate_mesh, elements, flatten_results=True)
# ---------- end create_fabricationelement_objects ----------

# ----
# PickStation
number_slider_3 = Slider(150, range=0..1000)
python_3 = GhPythonScript(
    pick_frames_path=path_2,
    elem_height=number_slider_2,
    elem_egress_distance=number_slider_3,
    station_egress_distance=Slider(400, range=0..1000),
    rotation=Slider(90, range=-360..360))  # -> out, pick_station, pick_planes
# ---------- python_3: Python ----------
import json
import math

from compas.geometry import Frame
from compas.geometry import Rotation

from rapid_clay_formations_fab.fab_data import PickStation
from rapid_clay_formations_fab.rhino import cgframe_to_rgplane


with open(pick_frames_path, mode="r") as fp:
     frame_data = json.load(fp)
     
pick_frames = [Frame.from_data(d) for d in frame_data]
if rotation:
    for f in pick_frames:
        R = Rotation.from_axis_and_angle(f.zaxis, math.radians(rotation), f.point)
        f.transform(R)
pick_station = PickStation(pick_frames, 
                            elem_height=elem_height, 
                            elem_egress_distance=elem_egress_distance,
                            station_egress_distance=station_egress_distance)
pick_planes = [cgframe_to_rgplane(f) for f in pick_frames]
# ---------- end python_3 ----------

pln_4 = Plane(create_fabricationelement_objects.planes)
pln_5 = Plane(create_fabricationelement_objects.egress_planes)

# ---- group: Clay bullet visualization
# Fabrication element meshes
mesh = Mesh(create_fabricationelement_objects.meshes)

# ----
# Preview planes (Z should b down)
number_slider_4 = Slider(51, range=0..100)
cluster = Cluster(plane=flatten(pln_3), amplitude=number_slider_4, R=Slider(1, range=0..10))  # -> geo, color
preview = CustomPreview(Geometry=cluster.geo, Material=cluster.color)

python_4 = GhPythonScript(
    fab_data=simplify(create_fabricationelement_objects.elements),
    xform=transform_2,
    conf_path=path,
    pick_station=python_3.pick_station,
    log_dir=path_4,
    save_dir=path_3,
    name=panel_5,
    save=save_json_file)  # -> out; inputs fab_data: list, xform: Transform, save: Boolean
# ---------- python_4: Python ----------
import json
import os
import datetime
import time

import System
import Rhino.Geometry as rg

from rapid_clay_formations_fab.utils import CompasObjEncoder
from rapid_clay_formations_fab.rhino import rgtransform_to_matrix
from rapid_clay_formations_fab.rhino import rgplane_to_cgframe

if fab_data is None:
    raise Exception("No fab_data specified.")

run_data = {}

run_data["fab_data"] = fab_data
run_data["conf_path"] = conf_path
run_data["pick_station"] = pick_station

run_data["log_dir"] = log_dir

datetime_now = datetime.datetime.now()
iso_timestamp = datetime_now.isoformat()

run_data["created"] = iso_timestamp

run_data["hostname"] = System.Net.Dns.GetHostName()

run_data["xform"] = rgtransform_to_matrix(xform)

plane = rg.Plane.WorldXY.Clone()
plane.Transform(xform)

run_data["rcf"] = rgplane_to_cgframe(plane)

if save:
    # file name can not contain comma and microseconds are overkill
    file_timestamp = datetime_now.strftime('%Y%m%dT%H.%M.%S')

    file_name = file_timestamp + "-" + name + ".json"
    full_path = os.path.join(save_dir, file_name)
    with open(full_path, mode='w') as fp:
        json.dump(run_data, fp, cls=CompasObjEncoder)
# ---------- end python_4 ----------

# ==== cluster Cluster
plane = ClusterInput()
amplitude = ClusterInput()
R = ClusterInput()
deconstruct_plane = DeconstructPlane(Plane=graft(plane))  # -> Origin, XAxis, YAxis, ZAxis
amplitude_2 = Amplitude(Vector=deconstruct_plane.XAxis, Amplitude=amplitude)
amplitude_3 = Amplitude(Vector=deconstruct_plane.YAxis, Amplitude=amplitude)
amplitude_4 = Amplitude(Vector=deconstruct_plane.ZAxis, Amplitude=amplitude)
move = Move(Geometry=deconstruct_plane.Origin, Motion=amplitude_3)  # -> Geometry, Transform
move_2 = Move(Geometry=deconstruct_plane.Origin, Motion=amplitude_4)  # -> Geometry, Transform
move_3 = Move(Geometry=deconstruct_plane.Origin, Motion=amplitude_2)  # -> Geometry, Transform
ln = Line(StartPoint=deconstruct_plane.Origin, EndPoint=move.Geometry)
ln_2 = Line(StartPoint=deconstruct_plane.Origin, EndPoint=move_3.Geometry)
ln_3 = Line(StartPoint=deconstruct_plane.Origin, EndPoint=move_2.Geometry)
pipe = Pipe(Curve=ln, Radius=R, Caps=0)  # -> simplify(Pipe)
pipe_2 = Pipe(Curve=ln_2, Radius=R, Caps=0)  # -> simplify(Pipe)
pipe_3 = Pipe(Curve=ln_3, Radius=R, Caps=0)  # -> simplify(Pipe)
path_mapper = PathMapper(pipe_2, source="{*}", target="{0}")
path_mapper_2 = PathMapper(ColourSwatch(SwatchColor=RGB(255, 0, 0)), source="{*}", target="{0}")
path_mapper_3 = PathMapper(pipe, source="{*}", target="{1}")
path_mapper_4 = PathMapper(ColourSwatch(SwatchColor=RGB(0, 255, 0)), source="{*}", target="{1}")
path_mapper_5 = PathMapper(ColourSwatch(SwatchColor=RGB(0, 0, 255)), source="{*}", target="{2}")
path_mapper_6 = PathMapper(pipe_3, source="{*}", target="{2}")
data = Data([path_mapper_6, path_mapper_3, path_mapper])
data_2 = Data([path_mapper_5, path_mapper_4, path_mapper_2])
geo = ClusterOutput(data)
color = ClusterOutput(data_2)
