# Grasshopper definition path_planning.ghx (Grasshopper 1.0.7)
# plug-ins: Human

axis_radius = Slider(3, range=0..10)
axis_length = Slider(100, range=0..100)
# Adapted from script by Gonzalo Casas at Gramazio Kohler Research, maintainer of compas_fab.
pt = Point(Point(0, 0, 354))
path = FilePath("G:\Shared drives\2020_MAS\T3\RCF-T3-Thesis\09-robot-control\06_robot_3d_model\200812_IF_with_picking_station_only_coll_mesh.3dm")
pl = ConstructPlane(Origin=pt, XAxis=Vector(1, 0, 0), YAxis=Vector(0, 1, 0))
deplane = DeconstructPlane(Plane=pl)  # -> Origin, XAxis, YAxis, ZAxis
amp = Amplitude(Vector=deplane.ZAxis, Amplitude=Slider(671, range=0..1000))
mesh = Mesh(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)
vdis = VectorDisplay(Anchor=deplane.Origin, Vector=amp)
pln = Plane(PlaneXY(0, 0, 354))
_3dm = Read3dmFile(FilePath=path, LayerFilter="*")  # -> Objects, LayerNames, Attributes, Units

mesh_2 = Mesh(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)
create_tool = GhPythonScript(mesh=mesh_2, id="tip")  # -> tool
# ---------- create_tool: Python ----------
from compas.geometry import Frame
from compas_rhino.geometry import RhinoMesh
from compas_fab.robots import Tool

compas_mesh = RhinoMesh.from_geometry(mesh).to_compas()
tool = Tool(compas_mesh, Frame((0, 0, 0), (1, 0, 0), (0, 1, 0)), name=id)
# ---------- end create_tool ----------

brep = Brep(<brep referenced from the Rhino model>)
cluster = Cluster(planes=pln, axis_length=axis_length, axis_radius=axis_radius)  # -> geo, color
mesh_3 = Mesh(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)

# ----
# Scene
mesh_4 = Mesh(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)
list = ValueList({"No meshes": 0, "Use meshes": 1}, selected="Use meshes")
create_tool_2 = GhPythonScript(mesh=mesh_3, id="table")  # -> cmesh
# ---------- create_tool_2: Python ----------
from compas_rhino.geometry import RhinoMesh
from compas_fab.robots import CollisionMesh

compas_mesh = RhinoMesh.from_geometry(mesh).to_compas()
cmesh = CollisionMesh(compas_mesh, id)
# ---------- end create_tool_2 ----------
collision_meshes = Data(create_tool_2)
filter = StreamFilter(Gate=list, Stream1=collision_meshes)

toggle = BooleanToggle(True)

# ---- group: Docker
# Container status
button = Button()
python = GhPythonScript(run=Button())  # -> out, status; inputs run: Boolean
# ---------- python: Python ----------
from scriptcontext import sticky

from subprocess import Popen
from subprocess import PIPE, STDOUT

cmd = ["docker", "ps", "--format", "\"{{.Names}}: {{.Status}}\""]

sticky["docker_ps_run"] = False

if run:
    sticky["docker_ps_run"] = True

if sticky["docker_ps_run"]:
    proc = Popen(cmd, stdout=PIPE, stderr=STDOUT, universal_newlines= True)
    sticky["docker_status"], _ = proc.communicate()
    sticky["docker_ps_run"] = False

if "docker_status" in sticky.keys():
    status  = sticky["docker_status"]
# ---------- end python ----------
python_2 = GhPythonScript(webgui=Toggle(True), start=button, restart_driver=Button(), stop=Button())  # -> out; inputs webgui: Boolean
# ---------- python_2: Python ----------
from compas_rcf.docker import compose_up
from compas_rcf.docker import compose_down
from compas_rcf.docker import restart_container

from compas_rcf.abb import DOCKER_COMPOSE_PATHS

import compas_rcf
print(compas_rcf.__version__)
compose_path = DOCKER_COMPOSE_PATHS["planner"]

print(compose_path)

if start:
    compose_up(compose_path)

if restart_driver:
    pass

if stop:
    compose_down(compose_path)
# ---------- end python_2 ----------
panel = Panel(python.status)

# ----
bang = Button()
mesh_5 = Mesh(brep)
mjoin = MeshJoin(Meshes=[mesh_4, mesh_5])
create_tool_3 = GhPythonScript(mesh=mesh, id="t_A057_ClayTool02", tcp=pln)  # -> tool; inputs tcp: Plane
# ---------- create_tool_3: Python ----------
from compas.geometry import Frame
from compas_rhino.geometry import RhinoMesh
from compas_fab.robots import Tool

from compas_rcf.utils import ensure_frame

compas_mesh = RhinoMesh.from_geometry(mesh).to_compas()
tool = Tool(compas_mesh, ensure_frame(tcp), name=id)
# ---------- end create_tool_3 ----------

# ----
# Current tool
list_2 = ValueList({"No tool": 0, "Tool 1": 1, "t_A057_ClayTool02": 2, "Tool 3": 3}, selected="t_A057_ClayTool02")
filter_2 = StreamFilter(Gate=list_2, Stream1=create_tool, Stream2=create_tool_3)

load = Button()
units = ValueList({"m": 1, "cm": 100, "mm": 1000}, selected="mm")
create = PythonScript(scale_factor=units, load=load, tool=filter_2, collision_meshes=filter)  # -> robot; inputs collision_meshes: list
# ---------- create: Python ----------
import os
import copy
from scriptcontext import sticky as st


import compas
from compas.geometry import Scale
from compas_fab.backends import RosClient
from compas_fab.ghpython import RobotArtist
from compas_fab.robots import PlanningScene
from compas_fab.robots import Tool

compas.PRECISION = '12f'

# store robot in component
guid = str(ghenv.Component.InstanceGuid)
robot_key = "robot_" + guid

if robot_key not in st:
    st[robot_key] = None

if load:
    with RosClient('127.0.0.1', 9090) as ros:
        robot = ros.load_robot(load_geometry=True)
        robot.artist = RobotArtist(robot.model)

        robot.scale(scale_factor)
        st[robot_key] = robot

robot = st[robot_key]

if robot:
    if tool:
        # Scale to meters to match ROS
        if scale_factor != 1:
            S = Scale([1. / scale_factor] * 3)
            tool = Tool.from_data(tool.data)
            tool.visual.transform(S)
            tool.collision.transform(S)

        touch_links = [l.name for l in robot.model.iter_link_chain()][-2:]
        robot.attach_tool(tool, touch_links=touch_links)
        
        # If a client is connected, we need to update the planning scene accordingly
        if robot.client:
            scene = PlanningScene(robot)
            scene.add_attached_tool()
    else:
        if robot.attached_tool:
            id = robot.attached_tool.name

            # If a client is connected, we need to update the planning scene accordingly
            if robot.client:
                scene.remove_attached_tool()
                scene.remove_collision_mesh(id)

            robot.detach_tool()

if robot.client:
    scene = PlanningScene(robot)

    cm_key = "cm_" + guid
    cm_ids = st.get(cm_key)

    if cm_ids:
        removed_cm_ids = set(cm_ids) - set([cm.id for cm in collision_meshes])
        if removed_cm_ids:
            for id in cm_ids:
                scene.remove_collision_mesh(id)
            
            print('Removing old CMs')
            print('Remove: ' + str(cm_ids))
            st[cm_key] = [id for id in cm_ids if id not in removed_cm_ids]

    if collision_meshes:
        print('Adding new CMs')
        st[cm_key] = []
        for cm in collision_meshes:
            cm = copy.deepcopy(cm)
            scene.add_collision_mesh(cm, scale=scale_factor != 1)
            st[cm_key].append(cm.id)
# ---------- end create ----------
robot = Data(create)

# ---- group: ROS client
connect = Button()
disconnect = Button()
ros = PythonScript(connect=connect, disconnect=disconnect, port="9090")  # -> out, ros_client; inputs port: Int32
# ---------- ros: Python ----------
import sys
import scriptcontext as sc
from compas_fab.backends import RosClient

key = 'rosclient_%s' % str(ghenv.Component.InstanceGuid)
previous_client = sc.sticky.get(key, None)

if not port:
    port = 9090

if previous_client and (connect or disconnect):
    previous_client.close()

if connect:

    ros_client = RosClient('127.0.0.1', port)
    sc.sticky[key] = ros_client
    ros_client.run(5)

ros_client = sc.sticky[key]
print('ROS connected: {}'.format(ros_client.is_connected if ros_client else 'False'))
# ---------- end ros ----------

# ----
unload = PythonScript(bang=bang, module="compas_rcf")
# ---------- unload: Python ----------
import sys

def unload_modules(top_level_module_name):
    """Unloads all modules named starting with the specified string.

    This function eases the development workflow when editing a library that is
    used from Rhino/Grasshopper.

    Args:
        top_level_module_name (:obj:`str`): Name of the top-level module to unload.

    Returns:
        list: List of unloaded module names.
    """
    modules = filter(lambda m: m.startswith(top_level_module_name), sys.modules)

    for module in modules:
        sys.modules.pop(module)

    return modules

unload_modules(module)
# ---------- end unload ----------
preview = CustomPreview(Geometry=cluster.geo, Material=cluster.color)

# ---- group: Set path to JSON
path_2 = FilePath("G:\Shared drives\2020_MAS\T3\RCF-T3-Thesis\09-robot-control\07-run_data\20200813-15.53.30-prototype_2A2.json")

# ----
panel_2 = Panel(path_2)
number_slider = Slider(0, range=0..100)
panel_3 = Panel(python_2)

# ----
# Robot
set = PythonScript(robot=robot, client=ros.ros_client)
# ---------- set: Python ----------
if robot and client:
    robot.client = client
# ---------- end set ----------

read_claybullets_from_json = GhPythonScript(path=path_2)  # -> out, cylinders, planes, meshes
# ---------- read_claybullets_from_json: Python ----------
import json

import ghpythonlib
from ghpythonlib.treehelpers import list_to_tree

from compas_rcf.fab_data import ClayBullet

if not path:
    raise Exception("No path given.")

with open(path, mode="r") as fp:
    run_data = json.load(fp)
print(run_data)
cylinders = [ClayBullet.from_data(data) for data in run_data["fab_data"]]

location_planes = [bullet.get_location_plane() for bullet in cylinders]

location_planes = list_to_tree(location_planes)

kwargs = {}
if face_count is not None:
    kwargs.update({'face_count': face_count})

def generate_mesh(bullet):
    return bullet.get_rgmesh(**kwargs)
    
# normal    
#meshes = [bullet.get_rg_mesh(**kwargs) for bullet in clay_bullets]

# parallel (quicker)
meshes = ghpythonlib.parallel.run(generate_mesh, cylinders, flatten_results=True)
# ---------- end read_claybullets_from_json ----------
panel_4 = Panel(ros.out)

# ---- group: Read JSON
# Read ClayBullets from JSON
read_claybullets_from_json_2 = GhPythonScript(path=path_2)  # -> out, cylinders, egress_pick_station, egress_pick_station_plane, egress_cylinders, egress_cylinders_planes, compressed_top_planes, location_planes, meshes
# ---------- read_claybullets_from_json_2: Python ----------
import json

import ghpythonlib
from ghpythonlib.treehelpers import list_to_tree

from compas_rcf.fab_data import PickStation
from compas_rcf.fab_data import ClayBullet
from compas_rcf.rhino import cgframe_to_rgplane

if not path:
    raise Exception("No path given.")

with open(path, mode="r") as fp:
    run_data = json.load(fp)

cylinders = [ClayBullet.from_data(data) for data in run_data["fab_data"]]

with open(run_data["pick_conf_path"], mode="r") as fp:
    pick_station = PickStation.from_data(json.load(fp))

egress_pick_station = pick_station.get_egress_frame()
egress_pick_station_plane = cgframe_to_rgplane(egress_pick_station)

egress_cylinders = [cylinder.get_egress_frame() for cylinder in cylinders]
egress_cylinders_planes = [cgframe_to_rgplane(frame) for frame in egress_cylinders]

compressed_top_frames = [cylinder.get_compressed_top_frame() for cylinder in cylinders]
compressed_top_planes = [cgframe_to_rgplane(frame) for frame in compressed_top_frames]

location_planes = [bullet.get_location_plane() for bullet in cylinders]

location_planes = list_to_tree(location_planes)



kwargs = {}
if face_count is not None:
    kwargs.update({'face_count': face_count})

def generate_mesh(bullet):
    return bullet.get_rgmesh(**kwargs)
    
# normal    
#meshes = [bullet.get_rg_mesh(**kwargs) for bullet in clay_bullets]

# parallel (quicker)
meshes = ghpythonlib.parallel.run(generate_mesh, cylinders, flatten_results=True)
# ---------- end read_claybullets_from_json_2 ----------

# ----
# Info
info = PythonScript(robot=robot)  # -> out, main_group_name
# ---------- info: Python ----------
if robot:
    robot.info()
    main_group_name = robot.main_group_name
# ---------- end info ----------
panel_5 = Panel(info.out)

mesh_6 = Mesh(read_claybullets_from_json_2.meshes)

# ---- group: Read ClayBullet attributes
python_3 = GhPythonScript(clay_bullets=read_claybullets_from_json_2.cylinders)  # -> out, location_planes, trajectories_to, trajectories_from, radii, heights, compression_ratios, bullet_ids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; inputs clay_bullets: list; disabled
# ---------- python_3: Python ----------
from ghpythonlib.treehelpers import list_to_tree
import System.DateTime

from compas_rcf.rhino import cgframe_to_rgplane

epoch = System.DateTime(1970, 1, 1, 0, 0, 0, 0)

_location_planes = []
_trajectories_to = []
_trajectories_from = []
radii = []
heights = []
compression_ratios = []
bullet_ids = []
placed_statuses = []
times_of_placement = []
cycle_times = []

for bullet in clay_bullets:
    _location_planes.append(bullet.get_location_plane())

    _trajectories_to.append([cgframe_to_rgplane(frame) for frame in bullet.trajectory_to])
    _trajectories_from.append([cgframe_to_rgplane(frame) for frame in bullet.trajectory_from])
    
    radii.append(bullet.radius)
    heights.append(bullet.height)
    compression_ratios.append(bullet.compression_ratio)
    bullet_ids.append(bullet.bullet_id)
    placed_statuses.append(isinstance(bullet.placed, (float, int)))
    
    if bullet.placed:
        times_of_placement.append(epoch.AddSeconds(bullet.placed))
    cycle_times.append(bullet.cycle_time)

location_planes = list_to_tree(_location_planes)
trajectories_to = list_to_tree(_trajectories_to)
trajectories_from = list_to_tree(_trajectories_from)
# ---------- end python_3 ----------

# ----
pln_2 = Plane(read_claybullets_from_json_2.egress_pick_station_plane)

# ----
# Preview planes (Z should b down)
number_slider_2 = Slider(10, range=0..100)
cluster_2 = Cluster_2(
    plane=flatten([read_claybullets_from_json_2.location_planes, pln_2]),
    amplitude=number_slider_2,
    R=Slider(1, range=0..10))  # -> geo, color
preview_2 = CustomPreview(Geometry=cluster_2.geo, Material=cluster_2.color)

pt_2 = ConstructPoint(XCoordinate=Slider(-500, range=-2000..2000), YCoordinate=Slider(-100, range=-2000..2000), ZCoordinate=0)
toggle_2 = BooleanToggle(True)  # disabled
dam = DataDam(BufferDelay=10000000, BufferMode=0)
move = Move(Geometry=read_claybullets_from_json_2.compressed_top_planes, Motion=pt_2)  # -> Geometry, Transform
item = ListItem(List=move.Geometry, Index=Slider(94, range=0..140), Wrap=False)

# ----
# Preview planes (Z should b down)
number_slider_3 = Slider(44, range=0..100)
cluster_3 = Cluster_2(plane=flatten(move.Geometry), amplitude=number_slider_3, R=Slider(1, range=0..10))  # -> geo, color
preview_3 = CustomPreview(Geometry=cluster_3.geo, Material=cluster_3.color)

# ---- group: Edit clay_bullets
# Edit trajectories
create_claybullet_objects = GhPythonScript(clay_bullets=read_claybullets_from_json_2.cylinders, enable=toggle_2)  # -> out, edited_clay_bullets, edited_planes, edited_trajectory_to, edited_trajectory_from; inputs clay_bullets: list, new_trajectory_to: list of Plane, new_trajectory_from: list of Plane, enable: Boolean; disabled
# ---------- create_claybullet_objects: Python ----------
from ghpythonlib.treehelpers import list_to_tree
from compas_rcf.rhino import cgframe_to_rgplane

if enable:
    edited_clay_bullets = [cylinder.copy() for cylinder in clay_bullets]
    for edited_bullet in edited_clay_bullets:
    
        if len(new_trajectory_to):
            edited_bullet.trajectory_to = new_trajectory_to
    
        if len(new_trajectory_from):
            edited_bullet.trajectory_from = new_trajectory_from

    _edited_planes = [bullet.get_location_plane() for bullet in edited_clay_bullets]
    _edited_trajectory_to = [cgframe_to_rgplane(frame) for frame in bullet.trajectory_to for bullet in edited_clay_bullets]
    _edited_trajectory_from = [cgframe_to_rgplane(frame) for frame in bullet.trajectory_from for bullet in edited_clay_bullets]
    
    edited_planes = list_to_tree(_edited_planes)
    edited_trajectory_to = list_to_tree(_edited_trajectory_to)
    edited_trajectory_from = list_to_tree(_edited_trajectory_from)
else:
    raise Exception("Toggle enable to run")
# ---------- end create_claybullet_objects ----------

# ----
# Cartesian path
number_slider_4 = Slider(20, range=0..210)
curve_path = Curve(<curve referenced from the Rhino model>)
divide = DivideCurve(Curve=curve_path, Count=number_slider_4, Kinks=False)  # -> Points, Tangents, Parameters
X = UnitX(Factor=1)
Y = UnitY(Factor=Slider(-1, range=-2..-1))
pl_2 = ConstructPlane(Origin=divide.Points, XAxis=X, YAxis=Y)

toggle_3 = BooleanToggle(True)
button_2 = Button()  # disabled
# Configuration
main_planning_group = Text(info.main_group_name)

# ----
# Kinematic path
tolerance = Slider(1, range=1..360)
python_4 = PythonScript(
    robot=robot,
    group=main_planning_group,
    start=read_claybullets_from_json_2.egress_pick_station_plane,
    goal=item,
    tolerance_joints_deg=tolerance)  # -> start_configuration, goal_constraints, goal_configuration, no_IK_planes; inputs start: Plane, goal: Plane
# ---------- python_4: Python ----------
import math

import rhinoscriptsyntax as rs
import Rhino.Geometry as rg

from compas.geometry import Frame

from compas_rcf.rhino import rgplane_to_cgframe

start_frame = rgplane_to_cgframe(start)
goal_frame = rgplane_to_cgframe(goal)

if robot.attached_tool:
    start_frame, goal_frame = robot.from_attached_tool_to_tool0([start_frame, goal_frame])

if robot:
    start_configuration = robot.inverse_kinematics(start_frame, group=group)
    print('Found start configuration for start marker')
    goal_configuration = robot.inverse_kinematics(goal_frame, group=group) # TODO: Add tolerances here
    print('Found goal configuration for goal marker')

    tolerances_above = [math.radians(tolerance_joints_deg)] * 6
    tolerances_below = [math.radians(tolerance_joints_deg)] * 6
    goal_constraints = robot.constraints_from_configuration(goal_configuration, tolerances_above, tolerances_below, group=group)
# ---------- end python_4 ----------

# ----
# Kinematic path
tolerance_2 = Slider(10, range=1..360)
python_5 = PythonScript(
    robot=robot,
    group=main_planning_group,
    pick_station_egress=read_claybullets_from_json_2.egress_pick_station,
    clay_cylinders=read_claybullets_from_json_2.cylinders,
    tolerance_joints_deg=tolerance_2,
    run=Button())  # -> start_configuration, goal_constraints_sets, goal_configurations, no_IK_planes; inputs clay_cylinders: list, run: Boolean
# ---------- python_5: Python ----------
import math

from scriptcontext import sticky as st

from compas_fab.backends import RosValidationError

from compas_rcf.rhino import cgframe_to_rgplane

guid = str(ghenv.Component.InstanceGuid)
goal_constraints_sets_key = "goal_constraints_sets" + guid
goal_configurations_key = "goal_configurations" + guid
no_IK_planes_key = "no_IK_planes" + guid
start_configuration_key = "start_configuration" + guid

start_frame = pick_station_egress

goal_frames = [cylinder.get_egress_frame() for cylinder in clay_cylinders]

# Joint tolerances for goal configurations
tolerances_above = [math.radians(tolerance_joints_deg)] * 6
tolerances_below = [math.radians(tolerance_joints_deg)] * 6

if robot and run:
    
    if robot.attached_tool:
        start_frame = robot.from_attached_tool_to_tool0([start_frame])[0]
        goal_frames = robot.from_attached_tool_to_tool0(goal_frames)

    st[start_configuration_key] = robot.inverse_kinematics(start_frame, group=group, attempts=10000)
    print('Found start configuration for start marker')
    
    st[goal_configurations_key] = []
    st[goal_constraints_sets_key] = []
    st[no_IK_planes_key] = [] 

    for i, frame in enumerate(goal_frames):
        try:
            goal_conf = robot.inverse_kinematics(frame, start_configuration=start_configuration, group=group, attempts=1000)
        except RosValidationError as e:
            if e.original_exception.error_code == -31:

                st[goal_configurations_key].append(None)
                st[goal_constraints_sets_key].append(None)
                st[no_IK_planes_key].append(cgframe_to_rgplane(frame))
                continue

        #print('Found goal configuration for goal marker {}'.format(i))
        st[goal_configurations_key].append(goal_conf)
    
        goal_constraints = robot.constraints_from_configuration(goal_conf, tolerances_above, tolerances_below, group=group)
    
        st[goal_constraints_sets_key].append(goal_constraints)

goal_configurations = st.get(goal_configurations_key)
goal_constraints_sets = st.get(goal_constraints_sets_key)
no_IK_planes = st.get(no_IK_planes_key)
start_configuration = st.get(start_configuration_key)

if no_IK_planes and len(no_IK_planes) < 1:
    print("Calculated inverse kinematics for all frames")
else:
    print("Couldn't calculate inverse kinematics for all frames.")
# ---------- end python_5 ----------

# ---- group: inverse kinematics
# IK
py = PythonScript(robot=robot)  # -> configuration
# ---------- py: Python ----------
from compas_fab.robots import Configuration

if robot:
    configuration = robot.zero_configuration()
    print configuration
# ---------- end py ----------
inverse_kinematics = PythonScript(robot=robot, group=main_planning_group, start_configuration=py)  # -> out, configuration
# ---------- inverse_kinematics: Python ----------
import rhinoscriptsyntax as rs 
import scriptcontext as sc
import logging

from compas.geometry import Frame

from compas_fab.backends.ros import RosError
from compas_fab.robots import Configuration

from compas_rcf.rhino import rgplane_to_cgframe

LOGGER = logging.getLogger('roslibpy')

guid = str(ghenv.Component.InstanceGuid)
response_key = "response_" + guid

if response_key not in sc.sticky:
    sc.sticky[response_key] = None

if robot:
    if robot.client:
        if robot.client.is_connected:
            goal_frame = rgplane_to_cgframe(plane)
            goal_frame = robot.from_attached_tool_to_tool0([goal_frame])
            response = robot.inverse_kinematics(goal_frame[0], start_configuration, group)
            sc.sticky[response_key] = response
        else:
            print("Robot is not connected")

if sc.sticky[response_key]:
    response = sc.sticky[response_key]
    configuration = response
# ---------- end inverse_kinematics ----------

# ----
pln_3 = Plane(python_5.no_IK_planes)

# ---- group: forward kinematics
a1 = Slider(41, range=-360..360)
a4 = Slider(0, range=-360..360)
a5 = Slider(0, range=-360..360)
a6 = Slider(0, range=-360..360)
a2 = Slider(0, range=-360..360)
a3 = Slider(0, range=-360..360)
forward_kinematics = PythonScript(robot=robot, group=main_planning_group, a1=a1, a2=a2, a3=a3, a4=a4, a5=a5, a6=a6)  # -> configuration
# ---------- forward_kinematics: Python ----------
import math
import Grasshopper
from compas_fab.robots import Configuration

if robot:
    joint_positions = [a1, a2, a3, a4, a5, a6]
    joint_positions = [math.radians(a) for a in joint_positions]
    types = robot.get_configurable_joint_types(group)
    configuration = Configuration(joint_positions, types)
    print configuration
# ---------- end forward_kinematics ----------

# ---- group: plan motion
# Plan motion
list_3 = ValueList({"don't use attached collision mesh": 0, "use attached collision mesh": 1}, selected="use attached collision mesh")
compute = Button()
list_4 = ValueList({"RRT", "RRT*": "RRTStar", "EST", "PRM": "RPM", "PRM*": "RPMStar", "SPARS"}, selected="RRT")
filter_3 = StreamFilter(Gate=list_3)
plan_motion = PythonScript(
    robot=robot,
    group=main_planning_group,
    start_configuration=python_4.start_configuration,
    goal_constraints=python_4.goal_constraints,
    planner_id=list_4,
    compute=compute,
    acm=filter_3)  # -> out, trajectory; inputs goal_constraints: list, path_constraints: list, acm: list
# ---------- plan_motion: Python ----------
import logging
from scriptcontext import sticky as st
import math
from compas.geometry import Frame
from compas_fab.robots import Configuration

from compas_ghpython.utilities import update_component

guid = str(ghenv.Component.InstanceGuid)
trajectory_key = "trajectory_" + guid
if trajectory_key not in st:
    st[trajectory_key] = None

data = dict(requesting_solution=False)

path_constraints = list(path_constraints)
if not len(path_constraints):
    path_constraints = None

if robot and robot.client and robot.client.is_connected and start_configuration and compute:
    st[trajectory_key] = robot.plan_motion(goal_constraints,
                                           start_configuration,
                                           group,
                                           planner_id=str(planner_id),
                                           path_constraints=path_constraints,
                                           attached_collision_meshes=list(acm))
#
trajectory = st[trajectory_key]
# ---------- end plan_motion ----------
vis = PythonScript(trajectory=plan_motion.trajectory)  # -> P, V, A, time
# ---------- vis: Python ----------
from compas_ghpython import list_to_ghtree

if trajectory:

    positions = []
    velocities = []
    accelerations = []
    time_from_start = []

    for p in trajectory.points:
        positions.append(p.positions)
        velocities.append(p.velocities)
        accelerations.append(p.accelerations)
        time_from_start.append(p.time_from_start.seconds)

    P = list_to_ghtree(list(zip(*positions)))
    V = list_to_ghtree(list(zip(*velocities)))
    A = list_to_ghtree(list(zip(*accelerations)))

    time = time_from_start[-1]
    print time
# ---------- end vis ----------
prismatic = QuickGraph(vis.P, SortOrder=0)
panel_6 = Panel("positions")
time_s = Panel(vis.time)
animate = PythonScript(
    robot=robot,
    start_configuration=python_4.start_configuration,
    trajectory=plan_motion.trajectory,
    goal_configuration=python_4.goal_configuration,
    value=Slider(0.2, range=0..1))  # -> configuration
# ---------- animate: Python ----------
from compas_fab.utilities import map_range
from compas_fab.robots import Configuration

full_result = []

if start_configuration:
    full_result.append(start_configuration)

if trajectory:
    full_result.extend([p for p in trajectory.points if p])

if goal_configuration:
    full_result.append(goal_configuration)

if len(full_result) and robot:
    idx = int(map_range(value, 0, 1, 0, len(full_result) - 1))
    configuration = full_result[idx]
# ---------- end animate ----------
graph = QuickGraph(vis.V, SortOrder=0)
graph_2 = QuickGraph(vis.A, SortOrder=0)
panel_7 = Panel("velocities")
panel_8 = Panel("accelerations")

# ----
panel_9 = Panel(python_5.no_IK_planes)

# ---- group: Write ClayBullets to JSON
# Write edited ClayBullets to JSON
write_claybullets_to_json = GhPythonScript(clay_bullets=simplify(create_claybullet_objects.edited_clay_bullets), file_path=path_2, save=button_2)  # -> out; inputs clay_bullets: list, save: Boolean; disabled
# ---------- write_claybullets_to_json: Python ----------
import json
from time import localtime
from time import strftime

from compas_rcf.fab_data import ClayBulletEncoder

if save is None:
    save = False

date_stamp_format = '%Y%m%d-%H.%M'

if save:
    new_path = file_path.replace(".json", "")
    new_path += "-edited-" + strftime(date_stamp_format, localtime()) + ".json"

    with open(new_path, mode='w') as fp:
        json.dump(clay_bullets, fp, cls=ClayBulletEncoder)
# ---------- end write_claybullets_to_json ----------

# ----
# Test IK for whole list
inverse_kinematics_2 = PythonScript(robot=robot, group=main_planning_group, start_configuration=py, planes=move.Geometry, run=Button())  # -> out, configurations, non_reachable_planes_idx, non_reachable_planes; inputs planes: list of Plane, run: Boolean
# ---------- inverse_kinematics_2: Python ----------
import logging

from scriptcontext import sticky as st

from compas_fab.backends.ros import RosValidationError

from compas_rcf.rhino import rgplane_to_cgframe
from compas_rcf.rhino import cgframe_to_rgplane

LOGGER = logging.getLogger('roslibpy')

guid = str(ghenv.Component.InstanceGuid)
configurations_key = "configurations" + guid
non_reachable_planes_idx_key  = "non_reachable_planes_idx" + guid
non_reachable_planes_key = "non_reachable_planes" + guid

if run and robot:
    if robot.client:
        if robot.client.is_connected:
            goal_frames = [rgplane_to_cgframe(plane) for plane in planes]
            
            if robot.attached_tool:
                goal_frames = robot.from_attached_tool_to_tool0(goal_frames)
            
            st[configurations_key] = []
            st[non_reachable_planes_idx_key] = []
            st[non_reachable_planes_key] = []
            
            for i, goal_frame in enumerate(goal_frames):
                configuration = st[configurations_key][-1] if len(st[configurations_key]) > 0 else start_configuration
                
                try:
                    response = robot.inverse_kinematics(goal_frame, configuration, group)
                except RosValidationError as e:
                    if e.original_exception.error_code == -31:
                        st[non_reachable_planes_idx_key].append(i)
                        st[non_reachable_planes_key].append(goal_frame)
                else:
                    st[configurations_key].append(response)
        else:
            print("Robot is not connected")

if robot.attached_tool and st.get(non_reachable_planes_key):
    st[non_reachable_planes_key] = robot.from_tool0_to_attached_tool(st[non_reachable_planes_key])

if st.get(non_reachable_planes_key):
    non_reachable_planes = [cgframe_to_rgplane(frame) for frame in st[non_reachable_planes_key]]

non_reachable_planes_idx = st.get(non_reachable_planes_idx_key)
configurations = st.get(configurations_key)

if non_reachable_planes_idx is None:
    num_unreachable = 0
else:
    num_unreachable = len(non_reachable_planes_idx)
    
print("{} unreachable frames".format(num_unreachable))
# ---------- end inverse_kinematics_2 ----------

# ---- group: cartesian motion
# Plan cartesian motion
number_slider_5 = Slider(10, range=0..100)
avoid_collisions = BooleanToggle(True)
list_5 = ValueList({"don't use attached collision mesh": 0, "use attached collision mesh": 1}, selected="use attached collision mesh")
compute_2 = Button()
filter_4 = StreamFilter(Gate=list_5)
plan_cartesian_motion = PythonScript(
    robot=robot,
    group=main_planning_group,
    planes=pl_2,
    max_step=number_slider_5,
    avoid_collisions=avoid_collisions,
    compute=compute_2,
    acm=filter_4)  # -> out, response; inputs planes: list, avoid_collisions: Boolean, acm: list
# ---------- plan_cartesian_motion: Python ----------
import logging
import scriptcontext as sc

from compas.geometry import Frame

guid = str(ghenv.Component.InstanceGuid)
response_key = "response_" + guid
if response_key not in sc.sticky:
    sc.sticky[response_key] = None

print('Planning with group={}, joints={}'.format(group, ', '.join(robot.get_configurable_joint_names(group))))

if robot:
    if robot.client:
        if robot.client.is_connected:
            frames = [Frame(plane.Origin, plane.XAxis, plane.YAxis) for plane in planes]
            start_configuration = robot.inverse_kinematics(frames[0], group=group)

            if start_configuration and compute:
                response = robot.plan_cartesian_motion(frames, start_configuration=start_configuration,
                                             max_step=float(max_step),
                                             avoid_collisions=bool(avoid_collisions),
                                             group=group,
                                             attached_collision_meshes=list(acm))
                print(response.fraction)
                sc.sticky[response_key] = response
        else:
            print("Robot is not connected")
            sc.sticky[response_key] = None

response = sc.sticky[response_key]
# ---------- end plan_cartesian_motion ----------
py_2 = PythonScript(response=plan_cartesian_motion.response)  # -> start_configuration, configurations, fraction, time
# ---------- py_2: Python ----------
from compas_fab.backends.ros import MoveItErrorCodes

joint_positions = []

if response:
    #if response.error_code == MoveItErrorCodes.SUCCESS:
    configurations = response.points
    start_configuration = response.start_configuration
    fraction = response.fraction
    time = response.time_from_start
# ---------- end py_2 ----------
vis_2 = PythonScript(response=plan_cartesian_motion.response)  # -> P, V, A
# ---------- vis_2: Python ----------
from compas_ghpython import list_to_ghtree

if response:

    positions = []
    velocities = []
    accelerations = []

    for p in response.points:
        positions.append(p.positions)
        velocities.append(p.velocities)
        accelerations.append(p.accelerations)

    P = list_to_ghtree(list(zip(*positions)))
    V = list_to_ghtree(list(zip(*velocities)))
    A = list_to_ghtree(list(zip(*accelerations)))
# ---------- end vis_2 ----------
time_s_2 = Panel(py_2.time)
fraction = Panel(py_2.fraction)
prismatic_2 = QuickGraph(vis_2.P, SortOrder=0)
graph_3 = QuickGraph(vis_2.V, SortOrder=0)
graph_4 = QuickGraph(vis_2.A, SortOrder=0)
animate_2 = PythonScript(
    robot=robot,
    group=main_planning_group,
    start_configuration=py_2.start_configuration,
    configurations=py_2.configurations,
    value=Slider(1, range=0..1))  # -> configuration; inputs configurations: list
# ---------- animate_2: Python ----------
from compas_fab.utilities import map_range
from compas_fab.robots import Configuration

count = len(configurations)
if count and robot and configurations != [None]:
    idx = int(map_range(value, 0, 1, 0, count - 1))
    current_configuration = configurations[idx]
    #make full configuration
    configuration = current_configuration
    #configuration = robot.merge_group_with_full_configuration(current_configuration, start_configuration, group)
# ---------- end animate_2 ----------

# ----
toggle_4 = BooleanToggle(True)

lng = ListLength(List=inverse_kinematics_2.configurations)
dom = ConstructDomain(DomainStart=0, DomainEnd=expr("x-1", lng))
remap = RemapNumbers(Value=Slider(0.24, range=0..1), Source=Domain(0, 1), Target=dom)  # -> Mapped, Clipped
item_2 = ListItem(List=inverse_kinematics_2.configurations, Index=remap.Clipped, Wrap=True)

pln_4 = Plane(inverse_kinematics_2.non_reachable_planes)

# ---- group: forward kinematics
fk = PythonScript(robot=robot, group=main_planning_group, configuration=inverse_kinematics.configuration)  # -> out, frame_WCF
# ---------- fk: Python ----------
import scriptcontext as sc
import logging
if robot:
    frame_WCF = robot.forward_kinematics(configuration, group, backend='model')

print frame_WCF
# ---------- end fk ----------
panel_13 = Panel(fk.out)

# ----
panel_14 = Panel(inverse_kinematics_2.out)
python_6 = GhPythonScript(x=plan_motion.trajectory)  # -> out, a, b
# ---------- python_6: Python ----------
__author__ = "a"
__version__ = "2020.08.11"

import rhinoscriptsyntax as rs
from copy import deepcopy
print(x)
y = deepcopy(x)

y.points.reverse()
a = [str(pt) for pt in x.points]
b = [str(pt) for pt in y.points]
# ---------- end python_6 ----------
number_slider_6 = Slider(0, range=0..140)
panel_15 = Panel(python_6.a)
item_3 = ListItem(List=python_5.goal_configurations, Index=number_slider_6, Wrap=True)
panel_16 = Panel(python_6.b)

# ----
# Configuration
path_3 = FilePath("G:\Shared drives\2020_MAS\T3\RCF-T3-Thesis\09-robot-control\02_fabrication_confs\20200731.yaml")
panel_17 = Panel(path_3)
file = ReadFile(File=path_3, PerLineParse=False)
panel_18 = Panel(file)

# ----
# WCS to RCS xform
path_4 = FilePath()

# ----
# Picking setup
path_5 = FilePath("G:\Shared drives\2020_MAS\T3\RCF-T3-Thesis\09-robot-control\05_picking_confs\picking_conf_03.json")
panel_19 = Panel(path_5)

# ----
# Save directory
path_6 = FilePath("G:\Shared drives\2020_MAS\T3\RCF-T3-Thesis\09-robot-control\07-run_data\")

# ----
# Folder for log files
path_7 = FilePath("G:\Shared drives\2020_MAS\T3\RCF-T3-Thesis\09-robot-control\03_fabrication_logs\")

# ----
# File name
panel_20 = Panel("prototype_2A1_ppl")

toggle_5 = BooleanToggle(True)

# ---- group: plan motion
# Plan motion
list_6 = ValueList({"don't use attached collision mesh": 0, "use attached collision mesh": 1}, selected="use attached collision mesh")
compute_3 = Button()
list_7 = ValueList({"RRT", "RRT*": "RRTStar", "EST", "PRM": "RPM", "PRM*": "RPMStar", "SPARS"}, selected="RRT")
filter_5 = StreamFilter(Gate=list_6)
plan_motion_2 = PythonScript(
    robot=robot,
    group=main_planning_group,
    start_configuration=python_5.start_configuration,
    goal_constraints_sets=python_5.goal_constraints_sets,
    planner_id=list_7,
    compute=Button(),
    acm=filter_5)  # -> out, start_configurations, trajectories, clay_cylinders; inputs goal_constraints_sets: list, path_constraints: list, acm: list
# ---------- plan_motion_2: Python ----------
import logging

import math

import rhinoscriptsyntax as rs
import Rhino.Geometry as rg
from scriptcontext import sticky as st

from compas.geometry import Frame

from compas_ghpython.utilities import update_component
from compas_fab.robots import Configuration

from compas_rcf.rhino import rgplane_to_cgframe

guid = str(ghenv.Component.InstanceGuid)
trajectory_key = "trajectory_" + guid

data = dict(requesting_solution=False)

path_constraints = list(path_constraints)
if not len(path_constraints):
    path_constraints = None

if robot and robot.client and robot.client.is_connected and start_configuration and compute:
    st[trajectory_key] = []
    for constraints in goal_constraints_sets:
        st[trajectory_key].append(robot.plan_motion(constraints,
                                           start_configuration,
                                           group,
                                           planner_id=str(planner_id),
                                           path_constraints=path_constraints,
                                           attached_collision_meshes=list(acm)))
#
trajectories = st.get(trajectory_key)
# ---------- end plan_motion_2 ----------

# ----
python_7 = GhPythonScript(trajectories=plan_motion_2.trajectories)  # -> out; inputs trajectories: list
# ---------- python_7: Python ----------
failed_trajectories = 0
for i, trajectory in enumerate(trajectories):
    if trajectory and trajectory.fraction < 1.0:
        failed_trajectories += 1
        print("Trajectory idx {} only completeted {:d} of its path.".format(i, trajectory.fraction * 100))
print("{} failed trajectories".format(failed_trajectories))
# ---------- end python_7 ----------
panel_24 = Panel(python_7)
python_8 = GhPythonScript(trajectories=plan_motion_2.trajectories, clay_cylinders=read_claybullets_from_json_2.cylinders)  # -> out, clay_cylinders; inputs trajectories: list, clay_cylinders: list
# ---------- python_8: Python ----------
from copy import deepcopy

for cylinder, trajectory in zip(clay_cylinders, trajectories):
    
    reverse_trajectory = deepcopy(trajectory)
    reverse_trajectory.points.reverse()
    
    cylinder.trajectory_to = trajectory
    cylinder.trajectory_from = reverse_trajectory
# ---------- end python_8 ----------
item_4 = ListItem(List=plan_motion_2.trajectories, Index=number_slider_6, Wrap=True)

# ---- group: plan motion (continued)
vis_3 = PythonScript(trajectory=item_4)  # -> P, V, A, time; same code as vis
prismatic_3 = QuickGraph(vis_3.P, SortOrder=0)
time_s_3 = Panel(vis_3.time)
animate_3 = PythonScript(
    robot=robot,
    start_configuration=plan_motion_2.start_configurations,
    trajectory=item_4,
    goal_configuration=item_3,
    value=Slider(0, range=0..1))  # -> configuration; same code as animate
graph_5 = QuickGraph(vis_3.V, SortOrder=0)
graph_6 = QuickGraph(vis_3.A, SortOrder=0)

# ----
# Visualization
# Select configuration input: from fk, ik, path
list_8 = ValueList({"0 forward_kinematics": 0, "1 inverse_kinematics": 1, "2 cartesian path": 2, "3 kinetic path": 3, "4 IK_test": 4}, selected="0 forward_kinematics")
filter_6 = StreamFilter(
    Gate=list_8,
    Stream0=forward_kinematics,
    Stream1=inverse_kinematics.configuration,
    Stream2=animate_2,
    Stream3=animate_3,
    Stream4=item_2)
show_end_effector_frame = BooleanToggle(False)
show_base_frame = BooleanToggle(False)
show_collision = BooleanToggle(False)
show_frames = BooleanToggle(True)
show_visual = BooleanToggle(True)
visualize = PythonScript(
    robot=robot,
    group=main_planning_group,
    configuration=filter_6,
    show_visual=show_visual,
    show_collision=show_collision,
    show_frames=show_frames,
    show_base_frame=show_base_frame,
    show_end_effector_frame=show_end_effector_frame)  # -> out, visual, collision, frames, ee_frame, base_frame
# ---------- visualize: Python ----------
"""Calculates a cartesian motion path (linear in tool space).
    Inputs:
        robot: The robot
        group: str
            The planning group used for visualisation
        full_configuration: :class:`compas_fab.robots.Configuration`
            The robot's full configuration to display.
        show_visual: bool
           Whether or not to show the robot's visual meshes.
        show_collision: bool
           Whether or not to show the robot's collision meshes.
        show_frames: bool
           Whether or not to show the robot's joint frames.
        show_base_frame: bool
           Whether or not to show the robot's base frame.
        show_end_effector_frame: bool
            Whether or not to show the robot's end-effector frame.
    Output:
        visual: The robot's visual meshes.
        collision: The robot's collision meshes.
        frames: The robot's joint frames.
        base_frame_WCF: The robot's base frame.
        ee_frame_WCF: The robot's end-effector frame.
"""
from __future__ import print_function

import copy

import Rhino.Geometry as rg
from compas.geometry import Scale
from compas_ghpython import draw_frame

if robot and configuration:
    robot.update(configuration, visual=show_visual, collision=show_collision)

    if show_visual:
        visual = list(robot.draw_visual())
        has_tool_attached = visual and robot.attached_tool
        needs_ee_scaling = robot.scale_factor != 1 and has_tool_attached
        if needs_ee_scaling and visual[-1] == robot.attached_tool.native_geometry[0]:
            ee_frame = robot.get_end_effector_frame(group, configuration)
            pln = rg.Plane(rg.Point3d(*list(ee_frame.point)), rg.Vector3d(*list(ee_frame.normal)))
            visual.append(pln)
            T = rg.Transform.Scale(pln, robot.scale_factor, robot.scale_factor, robot.scale_factor)
            ee_mesh = copy.copy(robot.attached_tool.native_geometry[0])
            ee_mesh.Transform(T)
            visual[-1] = ee_mesh

    if show_collision:
        collision = robot.draw_collision()

    if show_frames:
        axes = robot.transformed_axes(configuration)
        frames = robot.transformed_frames(configuration)
        frames = [draw_frame(frame) for frame in frames]

    if show_base_frame:
        base_frame = draw_frame(robot.get_base_frame(group, configuration))

    if show_end_effector_frame:
        ee_frame = draw_frame(robot.get_end_effector_frame(group, configuration))
        print("End-effector", ee_frame)
# ---------- end visualize ----------
geo = Geometry(visualize.visual)
geo_2 = Geometry(visualize.collision)
preview_4 = CustomPreview(Geometry=geo, Shader=ColourSwatch(SwatchColor=RGB(194, 194, 194)))

geo_3 = Geometry(visualize.frames)
geo_4 = Geometry(visualize.ee_frame)
geo_5 = Geometry(visualize.base_frame)
python_9 = GhPythonScript(
    fab_data=simplify(python_8.clay_cylinders),
    xform_path=path_4,
    conf_path=path_3,
    pick_conf_path=path_5,
    log_dir=path_7,
    save_dir=path_6,
    name=panel_20,
    save=Button())  # -> out; inputs fab_data: list, save: Boolean
# ---------- python_9: Python ----------
import json
import os
from time import strftime
from time import localtime

import System

from compas_rcf.utils import CompasObjEncoder

if fab_data is None:
    raise Exception("No fab_data specified.")

run_data = {}
print(fab_data)
run_data["fab_data"] = [cylinder.to_data() for cylinder in fab_data]
run_data["conf_path"] = conf_path
run_data["pick_conf_path"] = pick_conf_path
run_data["log_dir"] = log_dir

date_stamp_format = "%Y%m%d-%H.%M.%S"
timestamp = strftime(date_stamp_format, localtime())

run_data["created"] = timestamp

run_data["hostname"] = System.Net.Dns.GetHostName()

run_data["xform"] = xform_path

date_stamp_format = '%Y%m%d-%H.%M.%S'

if save:
    file_name = strftime(date_stamp_format, localtime()) + "-" + name + ".json"
    full_path = os.path.join(save_dir, file_name)
    with open(full_path, mode='w') as fp:
        json.dump(run_data, fp, cls=CompasObjEncoder)
# ---------- end python_9 ----------

# ==== cluster Cluster
planes = ClusterInput()
axis_length = ClusterInput()
axis_radius = ClusterInput()
deconstruct_plane = DeconstructPlane(Plane=graft(planes))  # -> Origin, XAxis, YAxis, ZAxis
amplitude = Amplitude(Vector=deconstruct_plane.XAxis, Amplitude=axis_length)
amplitude_2 = Amplitude(Vector=deconstruct_plane.YAxis, Amplitude=axis_length)
amplitude_3 = Amplitude(Vector=deconstruct_plane.ZAxis, Amplitude=axis_length)
move = Move(Geometry=deconstruct_plane.Origin, Motion=amplitude_2)  # -> Geometry, Transform
move_2 = Move(Geometry=deconstruct_plane.Origin, Motion=amplitude_3)  # -> Geometry, Transform
move_3 = Move(Geometry=deconstruct_plane.Origin, Motion=amplitude)  # -> Geometry, Transform
ln = Line(StartPoint=deconstruct_plane.Origin, EndPoint=move.Geometry)
ln_2 = Line(StartPoint=deconstruct_plane.Origin, EndPoint=move_3.Geometry)
ln_3 = Line(StartPoint=deconstruct_plane.Origin, EndPoint=move_2.Geometry)
pipe = Pipe(Curve=ln, Radius=axis_radius, Caps=0)
pipe_2 = Pipe(Curve=ln_2, Radius=axis_radius, Caps=0)
pipe_3 = Pipe(Curve=ln_3, Radius=axis_radius, Caps=0)
entwine = Entwine(
    Branch00=ColourSwatch(SwatchColor=RGB(255, 0, 0)),
    Branch01=ColourSwatch(SwatchColor=RGB(0, 255, 0)),
    Branch02=ColourSwatch(SwatchColor=RGB(0, 0, 255)),
    FlattenInputs=True)
entwine_2 = Entwine(Branch00=pipe_2, Branch01=pipe, Branch02=pipe_3, FlattenInputs=True)
geo = ClusterOutput(entwine_2)
color = ClusterOutput(entwine)

# ==== cluster Cluster_2
plane = ClusterInput()
amplitude = ClusterInput()
R = ClusterInput()
deconstruct_plane = DeconstructPlane(Plane=graft(plane))  # -> Origin, XAxis, YAxis, ZAxis
amplitude_2 = Amplitude(Vector=deconstruct_plane.XAxis, Amplitude=amplitude)
amplitude_3 = Amplitude(Vector=deconstruct_plane.YAxis, Amplitude=amplitude)
amplitude_4 = Amplitude(Vector=deconstruct_plane.ZAxis, Amplitude=amplitude)
move = Move(Geometry=deconstruct_plane.Origin, Motion=amplitude_3)  # -> Geometry, Transform
move_2 = Move(Geometry=deconstruct_plane.Origin, Motion=amplitude_4)  # -> Geometry, Transform
move_3 = Move(Geometry=deconstruct_plane.Origin, Motion=amplitude_2)  # -> Geometry, Transform
ln = Line(StartPoint=deconstruct_plane.Origin, EndPoint=move.Geometry)
ln_2 = Line(StartPoint=deconstruct_plane.Origin, EndPoint=move_3.Geometry)
ln_3 = Line(StartPoint=deconstruct_plane.Origin, EndPoint=move_2.Geometry)
pipe = Pipe(Curve=ln, Radius=R, Caps=0)  # -> simplify(Pipe)
pipe_2 = Pipe(Curve=ln_2, Radius=R, Caps=0)  # -> simplify(Pipe)
pipe_3 = Pipe(Curve=ln_3, Radius=R, Caps=0)  # -> simplify(Pipe)
path_mapper = PathMapper(pipe_2, source="{*}", target="{0}")
path_mapper_2 = PathMapper(ColourSwatch(SwatchColor=RGB(255, 0, 0)), source="{*}", target="{0}")
path_mapper_3 = PathMapper(pipe, source="{*}", target="{1}")
path_mapper_4 = PathMapper(ColourSwatch(SwatchColor=RGB(0, 255, 0)), source="{*}", target="{1}")
path_mapper_5 = PathMapper(ColourSwatch(SwatchColor=RGB(0, 0, 255)), source="{*}", target="{2}")
path_mapper_6 = PathMapper(pipe_3, source="{*}", target="{2}")
data = Data([path_mapper_6, path_mapper_3, path_mapper])
data_2 = Data([path_mapper_5, path_mapper_4, path_mapper_2])
geo = ClusterOutput(data)
color = ClusterOutput(data_2)
